# Grasshopper definition 240521 Table DL Check_NP.gh (Grasshopper 1.0.7)
# plug-ins: eleFront, CORE.Toolbox.Grasshopper

# ---- group: Room Upper / Opaque Faces
geometry = Geometry(<brep referenced from the Rhino model>)
panel = Panel("TestRoom")

# ---- group: Room Upper
brep = Brep([<brep referenced from the Rhino model> x6])
glassmod = HBGlassModifier(name="g_material", trans="0.4")  # -> modifier; plug-in component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
opaquemod = HBOpaqueModifier(reflect=Slider(0.5, range=0..1))  # -> modifier; plug-in component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
face = HBFace(geo=geometry, name=panel, rad_mod=opaquemod)  # -> report, faces; plug-in component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
aperture = HBAperture(geo=brep, rad_mod=glassmod)  # -> report, apertures; plug-in component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
bordershades = HBExtrudedBorderShades(hb_objs=flatten(aperture.apertures), depth="0.3")  # -> out, hb_objs; plug-in component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
addsubface = HBAddSubface(hb_obj=flatten(face.faces), sub_faces=flatten(bordershades.hb_objs))  # -> hb_obj; plug-in component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
room = HBRoom(faces=flatten(addsubface), conditioned=True)  # -> out, room; plug-in component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

# ---- group: Room Lower / Opaque Faces
geometry_2 = Geometry(<brep referenced from the Rhino model>)  # disabled
panel_2 = Panel("TestRoom")  # disabled

# ---- group: Room Lower
number_slider = Slider(0.5, range=0..1)  # disabled
panel_3 = Panel("g_material")  # disabled
# Geometry Preparation
brep_2 = Brep([<brep referenced from the Rhino model> x6])  # disabled
panel_4 = Panel("0.4")  # disabled
glassmod_2 = HBGlassModifier(name=panel_3, trans=panel_4)  # -> modifier; disabled; plug-in component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
opaquemod_2 = HBOpaqueModifier(reflect=number_slider)  # -> modifier; disabled; plug-in component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
face_2 = HBFace(geo=geometry_2, name=panel_2, rad_mod=opaquemod_2)  # -> report, faces; disabled; plug-in component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
aperture_2 = HBAperture(geo=brep_2, rad_mod=glassmod_2)  # -> report, apertures; disabled; plug-in component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
addsubface_2 = HBAddSubface(hb_obj=flatten(face_2.faces), sub_faces=flatten(aperture_2.apertures))  # -> hb_obj; disabled; plug-in component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
room_2 = HBRoom(faces=flatten(addsubface_2), conditioned=True)  # -> out, room; disabled; plug-in component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

# ----
# Wea
panel_5 = Panel("https://energyplus-weather.s3.amazonaws.com/southwest_pacific_wmo_region_5/SGP/SGP_Singapore.486980_IWEC/SGP_Singapore.486980_IWEC.zip")
downloadepw = LBDownloadWeather(weather_URL=panel_5)  # -> epw_file, stat_file, ddy_file; plug-in component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
wea = HBWeaFromEPW(epw_file=downloadepw.epw_file)  # -> wea; plug-in component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

# ---- group: Click run simulation First
# 1 Click simulation
boolean_toggle = BooleanToggle(False)

# ----
# Grid
deconstruct_brep = DeconstructBrep(Brep=geometry)  # -> reverse(Faces), Edges, Vertices
list_item = ListItem(List=deconstruct_brep.Faces, Index=0, Wrap=True)
flip = Flip(Surface=list_item)  # -> Surface, Result

panel_6 = Panel("""1
2""")

# ---- group: GridName
list_length = ListLength(List=flip.Surface)
duplicate_data = DuplicateData(Data="Grid", Number=list_length, Order=True)  # -> simplify(graft(Data))
series = Series(Start="1", Step=1, Count=list_length)  # -> simplify(graft(Series))
text_join = TextJoin(Text=[duplicate_data, series], Join="_")
panel_7 = Panel(text_join)

# ----
# Room Boundary
room_boundary = Data(list_item)

# ----
# Model + Grids
number_slider_2 = Slider(0.76, range=0..1)
panel_8 = Panel("sample_model_grid")
grid = Brep(flip.Surface)
genpts = LBGeneratePointGrid(geometry=grid, grid_size="0.3", offset_dist=number_slider_2, quad_only=Toggle(True))  # -> simplify(points), simplify(vectors), face_areas, simplify(mesh); plug-in component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
model = HBModel(rooms=flatten(room.room))  # -> out, model; plug-in component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
sensorgrid = HBSensorGrid(name=panel_7, positions=genpts.points, directions=genpts.vectors)  # -> grid; plug-in component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
vizwiref = HBVisualizeWireframe(hb_objs=flatten(model.model))  # -> geo; plug-in component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
assigngridsviews = HBAssignGridsAndViews(model=model.model, grids=flatten(sensorgrid))  # -> model; plug-in component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

point_data = Data(genpts.points)
point_data_2 = Data([Point(0.1421987035, -146.7080315, 6.76), Point(0.1421987035, -146.4079894, 6.76), Point(0.1421987035, -146.1079473, 6.76), Point(0.1421987035, -145.8079052, 6.76), Point(0.1421987035, -145.5078631, 6.76), Point(0.1421987035, -145.207821, 6.76)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])

# ----
# 2 Collect Simulation Data
# (Link & Internalise data)
mesh_data = Data(genpts.mesh)
mesh_data_2 = Data(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)

offset_from_the_wall = Slider(2, range=1..2)
value_list = ValueList({"1.2 x 0.6": 0, "1.4 x 0.7": 1, "1.6 x 0.8": 2, "Cluster type": 3}, selected="1.2 x 0.6")
columns = Slider(4, range=1..10)
rows = Slider(1, range=1..3)
angle = Panel("0")
brute_force = BruteForce(Run=Button(), Input1=offset_from_the_wall, Input2=columns, Input3=rows, Input4=angle, Input5=Slider(0, range=0..2))  # -> Permutation, Output1, Output2, Output3, Output4, Output5
rectangle = Rectangle(Plane=PlaneXY(0, 0, 0), XSize=Slider(10, range=0..100), YSize=Slider(25, range=0..100), Radius=0)  # -> Rectangle, Length
stream_filter = StreamFilter(Gate=brute_force.Output5, Stream0="Table_01", Stream1="Table_02", Stream2="Table_03", Stream3="Cluster_table")
negative = Negative(Value=brute_force.Output1)
offset_curve = OffsetCurve(Curve=room_boundary, Distance=negative, Corners=1)
explode = Explode(Curve=offset_curve, Recursive=True)  # -> Segments, Vertices
list_item_2 = ListItem(List=explode.Segments, Index=0, Wrap=True)  # -> Item, Item1, Item2, Item3
geometry_3 = Geometry(list_item_2.Item)
geometry_4 = Geometry(list_item_2.Item2)
geometry_5 = Geometry(list_item_2.Item1)
geometry_6 = Geometry(list_item_2.Item3)
divide_curve = DivideCurve(Curve=geometry_3, Count=10, Kinks=False)  # -> Points, Tangents, Parameters
divide_curve_2 = DivideCurve(Curve=geometry_4, Count=10, Kinks=False)  # -> Points, Tangents, Parameters
number_slider_3 = Slider(0.5, range=0..1)  # disabled
reverse_list = ReverseList(List=divide_curve_2.Points)
point_list = PointList(Points=[divide_curve_2.Points, divide_curve.Points], Size=number_slider_3)  # disabled
entwine = Entwine(Branch00=divide_curve.Points, Branch01=reverse_list, FlattenInputs=True)
flip_matrix = FlipMatrix(Data=entwine)
reference_block_by_name = ReferenceBlockByName(BlockName=stream_filter, getNestedBlocks=False, lightweight=False)
polyline = PolyLine(Vertices=flip_matrix, Closed=False)  # -> flatten(Polyline)
explode_block = ExplodeBlock(Block=reference_block_by_name, recursive=False)  # -> Name, Transform, Geometry
surface = Surface(explode_block.Geometry)
area = Area(Geometry=surface)  # -> Area, Centroid

columns_2 = Data(brute_force.Output2)
rows_2 = Data(brute_force.Output3)

rotation_angle = Data(brute_force.Output4)
case_name = Data(brute_force.Permutation)
wall_offset = Data(brute_force.Output1)
table_type = Data(explode_block.Name)

# ---- group: CaseName
data = Data(case_name)
concatenate = Concatenate(FragmentA="CASE_", FragmentB=data)

# ----
rotationangle = Data(rotation_angle)
walloffset = Data(wall_offset)

table_type_2 = Data(table_type)

# ----
# Run Recipe
boolean_toggle_2 = BooleanToggle(False)
morning_hour = Panel("7")
evening_hour = Panel("17")
analysisperiod = LBAnalysisPeriod(start_month=1, start_day=1, start_hour=morning_hour, end_hour=evening_hour)  # -> period, hoys, dates; plug-in component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

# ---- group: There is a change in the input or output! Replace this component manually.
annualdaylight = HBAnnualDaylight(model=assigngridsviews, wea=wea, enhanced=boolean_toggle_2, run=boolean_toggle)  # -> report, results, DA, cDA, UDI, UDI_low, UDI_up; plug-in component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

# ----
avgvalues = HBAnnualAverageValues(results=annualdaylight.results, hoys=analysisperiod.hoys, median=Toggle(True))  # -> out, values; plug-in component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

average_illuminance_data = Data(avgvalues.values)
average_illuminance_data_2 = Data([54.92, 87.06, 245.13, 1769.84, 2604.77, 2583.5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])
average_illuminance_data_3 = Data([54.92, 87.06, 245.13, 1769.84, 2604.77, 2583.5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])

# ----
# Visualize Average Illuminance
number_slider_4 = Slider(2000, range=0..10000)
legendpar = LBLegendParameters(min=0, max=number_slider_4)  # -> leg_par; plug-in component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
heatmap = LBSpatialHeatmap(values=simplify(average_illuminance_data_3), mesh=simplify(mesh_data_2), legend_par=legendpar)  # -> mesh, legend, title, colors, legend_par, vis_set; plug-in component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
mesh = Mesh(heatmap.mesh)

divide_curve_3 = DivideCurve(Curve=geometry_5, Count=rows_2, Kinks=False)  # -> Points, Tangents, Parameters
divide_curve_4 = DivideCurve(Curve=geometry_6, Count=rows_2, Kinks=False)  # -> Points, Tangents, Parameters
reverse_list_2 = ReverseList(List=divide_curve_4.Points)
entwine_2 = Entwine(Branch00=divide_curve_3.Points, Branch01=reverse_list_2, FlattenInputs=True)
flip_matrix_2 = FlipMatrix(Data=entwine_2)
polyline_2 = PolyLine(Vertices=flip_matrix_2, Closed=False)  # -> flatten(Polyline)
divide_curve_5 = DivideCurve(Curve=polyline_2, Count=columns_2, Kinks=False)  # -> Points, Tangents, Parameters
xy_plane = XYPlane(Origin=divide_curve_5.Points)

vector_2pt = Vector2Pt(PointA=area.Centroid, PointB=divide_curve_5.Points, Unitize=False)  # -> Vector, Length
move = Move(Geometry=explode_block.Geometry, Motion=vector_2pt.Vector)  # -> Geometry, Transform

rotate = Rotate(Geometry=move.Geometry, Angle=degrees(brute_force.Output4), Plane=xy_plane)  # -> Geometry, Transform
geometry_7 = Geometry(rotate.Geometry)

# ----
# Table data set
tablegeometry = Brep(geometry_7)

unit_z = UnitZ(Factor="2")
extrude = Extrude(Base=tablegeometry, Direction=unit_z)
point_in_breps = PointInBreps(Brep=graft(extrude), Point=point_data_2, Strict=False)  # -> simplify(Inside), simplify(Index)
dispatch = Dispatch(List=average_illuminance_data_2, DispatchPattern=point_in_breps.Inside)  # -> ListA, ListB
match_tree = MatchTree(Tree=dispatch.ListA, Guide=point_in_breps.Inside)
average = Average(Input=match_tree)
shift_paths = ShiftPaths(Data=average, Offset=-1)
data_2 = Data(simplify(divide_curve_5.Points))

table_location = Panel(data_2)
illuminance_on_table = Panel(shift_paths)
list_length_2 = ListLength(List=table_location)
panel_9 = Panel(concatenate)
# 4 Save data
# 
# Right click on green panel and and click at
#      Strem destination  = choose folder to save
#      Steam content  = save data
duplicate_data_2 = DuplicateData(Data=panel_9, Number=list_length_2, Order=True)

unit_z_2 = UnitZ(Factor="1")
move_2 = Move(Geometry=tablegeometry, Motion=unit_z_2)  # -> Geometry, Transform
round = Round(Number=shift_paths)  # -> Nearest, Floor, Ceiling
area_2 = Area(Geometry=move_2.Geometry)  # -> Area, Centroid
text_tag = TextTag(Location=simplify(area_2.Centroid), Text=simplify(round.Nearest), Colour=ColourSwatch(SwatchColor=RGB(153, 153, 153)))
custom_preview = CustomPreview(Geometry=move_2.Geometry, Material=ColourSwatch(SwatchColor=RGB(255, 255, 255)))

collision_many_many = CollisionManyMany(Colliders=tablegeometry)  # -> Collision, Indices
duplicate_data_3 = DuplicateData(Data=table_type_2, Number=list_length_2, Order=True)
duplicate_data_4 = DuplicateData(Data=walloffset, Number=list_length_2, Order=True)
duplicate_data_5 = DuplicateData(Data=rotationangle, Number=list_length_2, Order=True)

entwine_3 = Entwine(
    Branch00=flatten(duplicate_data_2),
    Branch01=flatten(collision_many_many.Collision),
    Branch02=flatten(duplicate_data_3),
    Branch03=flatten(duplicate_data_4),
    Branch04=flatten(duplicate_data_5),
    Branch05=flatten(table_location),
    Branch06=flatten(illuminance_on_table),
    FlattenInputs=True)
flip_matrix_3 = FlipMatrix(Data=entwine_3)
text_join_2 = TextJoin(Text=flip_matrix_3, Join=",")  # -> flatten(Result)
panel_10 = Panel("Case,OverlabChecked,TableType,WallOffset,Rotation,TableLocation,AVG_Lux")

data_recorder = DataRecorder(text_join_2, DataLimit=-10, RecordData=True)

panel_11 = Panel(data_recorder)

merge = Merge(Data1=panel_10, Data2=panel_11)
panel_12 = Panel(merge)
