# Grasshopper definition 05_table_r1.gh (Grasshopper 1.0.7)
# plug-ins: Bifocals, eleFront, Pufferfish, CORE.Toolbox.Grasshopper

offset_from_the_wall = Slider(1, range=1..2)
value_list = ValueList({"1.2 x 0.6": 0, "1.4 x 0.7": 1, "1.6 x 0.8": 2, "Cluster type": 3}, selected="1.2 x 0.6")
columns = Slider(4, range=1..4)
rows = Slider(10, range=1..10)
angle = Panel("""0
90""")
brute_force = BruteForce(Run=Button(), Input1=offset_from_the_wall, Input2=columns, Input3=rows, Input4=angle, Input5=Slider(0, range=0..2))  # -> Permutation, Output1, Output2, Output3, Output4, Output5
series = Series(Start="0", Step="0.6", Count=Slider(28, range=0..28))
rectangle = Rectangle(Plane=PlaneXY(0, 0, 0), XSize=Slider(10, range=0..100), YSize=Slider(25, range=0..100), Radius=0)  # -> Rectangle, Length
unit_x = UnitX(Factor=series)
series_2 = Series(Start="0", Step="1.2", Count=Slider(14, range=0..28))
stream_filter = StreamFilter(Gate=brute_force.Output5, Stream0="Table_01", Stream1="Table_02", Stream2="Table_03", Stream3="Cluster_table")
geometry = Geometry(<brep referenced from the Rhino model>)
negative = Negative(Value=brute_force.Output1)
offset_curve = OffsetCurve(Curve=rectangle.Rectangle, Distance=negative, Corners=1)
unit_x_2 = UnitX(Factor=series_2)
negative_2 = Negative(Value="1.2")
negative_3 = Negative(Value="3.6")
negative_4 = Negative(Value="4.8")
negative_5 = Negative(Value="2.4")
move = Move(Geometry=geometry, Motion=unit_x)  # -> Geometry, Transform
geometry_2 = Geometry(<brep referenced from the Rhino model>)
negative_6 = Negative(Value="4.8")
negative_7 = Negative(Value="0.6")
negative_8 = Negative(Value="4.2")
negative_9 = Negative(Value="5.4")
negative_10 = Negative(Value="2.4")
negative_11 = Negative(Value="1.8")
explode = Explode(Curve=offset_curve, Recursive=True)  # -> Segments, Vertices
negative_12 = Negative(Value="3.0")
negative_13 = Negative(Value="3.6")
negative_14 = Negative(Value="1.2")
move_2 = Move(Geometry=geometry_2, Motion=unit_x_2)  # -> Geometry, Transform
unit_y = UnitY(Factor=negative_2)
unit_y_2 = UnitY(Factor=negative_3)
unit_y_3 = UnitY(Factor=negative_4)
unit_y_4 = UnitY(Factor=negative_5)
geometry_3 = Geometry(move.Geometry)
unit_y_5 = UnitY(Factor=negative_7)
unit_y_6 = UnitY(Factor=negative_6)
unit_y_7 = UnitY(Factor=negative_11)
unit_y_8 = UnitY(Factor=negative_8)
unit_y_9 = UnitY(Factor=negative_9)
unit_y_10 = UnitY(Factor=negative_10)
unit_y_11 = UnitY(Factor=negative_12)
unit_y_12 = UnitY(Factor=negative_13)
unit_y_13 = UnitY(Factor=negative_14)
move_3 = Move(Geometry=geometry_3, Motion=unit_y_2)  # -> Geometry, Transform
list_item = ListItem(List=explode.Segments, Index=0, Wrap=True)  # -> Item, Item1, Item2, Item3
move_4 = Move(Geometry=geometry_3, Motion=unit_y)  # -> Geometry, Transform
move_5 = Move(Geometry=geometry_3, Motion=unit_y_3)  # -> Geometry, Transform
move_6 = Move(Geometry=geometry_3, Motion=unit_y_4)  # -> Geometry, Transform
geometry_4 = Geometry(move_2.Geometry)
move_7 = Move(Geometry=geometry_4, Motion=unit_y_6)  # -> Geometry, Transform
move_8 = Move(Geometry=geometry_4, Motion=unit_y_7)  # -> Geometry, Transform
move_9 = Move(Geometry=geometry_4, Motion=unit_y_8)  # -> Geometry, Transform
move_10 = Move(Geometry=geometry_4, Motion=unit_y_9)  # -> Geometry, Transform
move_11 = Move(Geometry=geometry_4, Motion=unit_y_5)  # -> Geometry, Transform
move_12 = Move(Geometry=geometry_4, Motion=unit_y_10)  # -> Geometry, Transform
move_13 = Move(Geometry=geometry_4, Motion=unit_y_11)  # -> Geometry, Transform
move_14 = Move(Geometry=geometry_4, Motion=unit_y_12)  # -> Geometry, Transform
move_15 = Move(Geometry=geometry_4, Motion=unit_y_13)  # -> Geometry, Transform
geometry_5 = Geometry(list_item.Item1)
geometry_6 = Geometry(list_item.Item3)
geometry_7 = Geometry(list_item.Item)
geometry_8 = Geometry(list_item.Item2)
data = Data(geometry_3)
data_2 = Data(move_4.Geometry)
data_3 = Data(move_6.Geometry)
data_4 = Data(move_3.Geometry)
data_5 = Data(move_5.Geometry)
divide_curve = DivideCurve(Curve=geometry_7, Count=10, Kinks=False)  # -> Points, Tangents, Parameters
divide_curve_2 = DivideCurve(Curve=geometry_8, Count=10, Kinks=False)  # -> Points, Tangents, Parameters
divide_curve_3 = DivideCurve(Curve=geometry_5, Count=brute_force.Output3, Kinks=False)  # -> Points, Tangents, Parameters
divide_curve_4 = DivideCurve(Curve=geometry_6, Count=brute_force.Output3, Kinks=False)  # -> Points, Tangents, Parameters
number_slider = Slider(0.5, range=0..1)  # disabled
data_6 = Data(geometry_4)
data_7 = Data(move_11.Geometry)
data_8 = Data(move_15.Geometry)
data_9 = Data(move_12.Geometry)
data_10 = Data(move_13.Geometry)
data_11 = Data(move_8.Geometry)
data_12 = Data(move_14.Geometry)
number_slider_2 = Slider(101, range=0..139)
data_13 = Data(move_7.Geometry)
data_14 = Data(move_9.Geometry)
data_15 = Data(move_10.Geometry)
gene_pool = GenePool(
    Decimals=0,
    Maximum=140,
    Minimum=0,
    Value=[56.27287249, 59.10502971, 48.45713692, 33.56914909, 23.27659844, 61.77913743, 46.73363012, 107.1513034, 139.4860943, 80.99346611])
geometry_9 = Geometry([data, data_2, data_3, data_4, data_5])
reverse_list = ReverseList(List=divide_curve_2.Points)
reverse_list_2 = ReverseList(List=divide_curve_4.Points)
gene_pool_2 = GenePool(
    Decimals=0,
    Maximum=140,
    Minimum=0,
    Value=[20.54537559, 134.0705604, 73.44300259, 118.1027602, 6.252973767, 108.9973346, 97.86474665, 14.86598627, 102.6058675, 113.6835263])
number_slider_3 = Slider(88, range=0..139)
geometry_10 = Geometry([data_6, data_7, data_8, data_11, data_9, data_10, data_12, data_14, data_13, data_15])
list_item_2 = ListItem(List=geometry_9, Index=gene_pool, Wrap=True)
point_list = PointList(Points=[divide_curve_2.Points, divide_curve.Points], Size=number_slider)  # disabled
entwine = Entwine(Branch00=divide_curve.Points, Branch01=reverse_list, FlattenInputs=True)
entwine_2 = Entwine(Branch00=divide_curve_3.Points, Branch01=reverse_list_2, FlattenInputs=True)
area = Area(Geometry=list_item_2)  # -> Area, Centroid
list_item_3 = ListItem(List=geometry_10, Index=gene_pool_2, Wrap=True)
flip_matrix = FlipMatrix(Data=entwine)
flip_matrix_2 = FlipMatrix(Data=entwine_2)
area_2 = Area(Geometry=list_item_3)  # -> Area, Centroid
point = Point(area.Centroid)
reference_block_by_name = ReferenceBlockByName(BlockName=stream_filter, getNestedBlocks=False, lightweight=False)
polyline = PolyLine(Vertices=flip_matrix, Closed=False)  # -> flatten(Polyline)
polyline_2 = PolyLine(Vertices=flip_matrix_2, Closed=False)  # -> flatten(Polyline)
point_2 = Point(area_2.Centroid)
co_ordinates = Panel(point)
co_ordinates_2 = Panel(point_2)
divide_curve_5 = DivideCurve(Curve=polyline_2, Count=brute_force.Output2, Kinks=False)  # -> Points, Tangents, Parameters
explode_block = ExplodeBlock(Block=reference_block_by_name, recursive=False)  # -> Name, Transform, Geometry
merge = Merge(Data1=co_ordinates, Data2=co_ordinates_2)
cull_duplicates = CullDuplicates(Points=merge, Tolerance=0.1, CullMode=3)  # -> Points, Indices, Valence
surface = Surface(explode_block.Geometry)
point_3 = Point(cull_duplicates.Points)
area_3 = Area(Geometry=surface)  # -> Area, Centroid
panel = Panel(merge)
move_to_point = MoveToPoint(Geometry=reference_block_by_name, PointA=area_3.Centroid, PointB=divide_curve_5.Points)  # -> Moved, Vector, Transform
xy_plane = XYPlane(Origin=divide_curve_5.Points)
rotate = Rotate(Geometry=flatten(move_to_point.Moved), Angle=degrees(brute_force.Output4), Plane=flatten(xy_plane))  # -> Geometry, Transform
geometry_11 = Geometry(rotate.Geometry)
