# Grasshopper definition 240521 Table DL Check_NP_Naveen.gh (Grasshopper 1.0.8)
# plug-ins: CORE.Toolbox.Grasshopper, Human, LunchBox, eleFront

# ---- group: Elefront part
layer_table = LayerTable(Update=Button(), AutoUpdate=False)  # -> Layers, FullLayerPaths, LayerColors, Linetypes, MaterialNames, Visible, PrintWidth, PrintColor
list_item = ListItem(List=layer_table.Layers, Index=Slider(1, range=0..10), Wrap=True)
list_item_2 = ListItem(List=layer_table.Layers, Index=Slider(2, range=0..10), Wrap=True)
reference_by_layer = ReferenceByLayer(LayerName=list_item, lightweight=False)
reference_by_layer_2 = ReferenceByLayer(LayerName=list_item_2, lightweight=False)

# ----
list_length = ListLength(NoOfOpening=reference_by_layer)

# ---- group: Room Upper / Opaque Faces
geometry = Geometry(reference_by_layer_2)
panel = Panel("TestRoom")

# ---- group: Room Upper
brep = Brep(reference_by_layer)
glassmod = HBGlassModifier(name="g_material", trans="0.4")  # -> modifier; plug-in component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
opaquemod = HBOpaqueModifier(reflect=Slider(0.5, range=0..1))  # -> modifier; plug-in component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
face = HBFace(geo=geometry, name=panel, rad_mod=opaquemod)  # -> report, faces; plug-in component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
aperture = HBAperture(geo=brep, rad_mod=glassmod)  # -> report, apertures; plug-in component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
bordershades = HBExtrudedBorderShades(hb_objs=flatten(aperture.apertures), depth="0.3")  # -> out, hb_objs; plug-in component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
addsubface = HBAddSubface(hb_obj=flatten(face.faces), sub_faces=flatten(bordershades.hb_objs))  # -> hb_obj; plug-in component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
room = HBRoom(faces=flatten(addsubface), conditioned=True)  # -> out, room; plug-in component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

# ----
# Wea
panel_2 = Panel("https://energyplus-weather.s3.amazonaws.com/southwest_pacific_wmo_region_5/SGP/SGP_Singapore.486980_IWEC/SGP_Singapore.486980_IWEC.zip")
downloadepw = LBDownloadWeather(weather_URL=panel_2)  # -> epw_file, stat_file, ddy_file; plug-in component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
wea = HBWeaFromEPW(epw_file=downloadepw.epw_file)  # -> wea; plug-in component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

# ---- group: Click run simulation First
# 1 Click simulation
boolean_toggle = BooleanToggle(False)

# ----
# Grid
deconstruct_brep = DeconstructBrep(Brep=geometry)  # -> reverse(Faces), Edges, Vertices
list_item_3 = ListItem(List=deconstruct_brep.Faces, Index=0, Wrap=True)
flip = Flip(Surface=list_item_3)  # -> Surface, Result

# ---- group: GridName
list_length_2 = ListLength(List=flip.Surface)
duplicate_data = DuplicateData(Data="Grid", Number=list_length_2, Order=True)  # -> simplify(graft(Data))
series = Series(Start="1", Step=1, Count=list_length_2)  # -> simplify(graft(Series))
text_join = TextJoin(Text=[duplicate_data, series], Join="_")
panel_3 = Panel(text_join)

# ----
# Room Boundary
room_boundary = Data(list_item_3)

# ----
# Model + Grids
number_slider = Slider(0.76, range=0..1)
panel_4 = Panel("sample_model_grid")
grid = Brep(flip.Surface)
genpts = LBGeneratePointGrid(geometry=grid, grid_size="0.3", offset_dist=number_slider, quad_only=Toggle(True))  # -> simplify(points), simplify(vectors), face_areas, simplify(mesh); plug-in component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
model = HBModel(rooms=flatten(room.room))  # -> out, model; plug-in component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
sensorgrid = HBSensorGrid(name=panel_3, positions=genpts.points, directions=genpts.vectors)  # -> grid; plug-in component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
vizwiref = HBVisualizeWireframe(hb_objs=flatten(model.model))  # -> geo; plug-in component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
assigngridsviews = HBAssignGridsAndViews(model=model.model, grids=flatten(sensorgrid))  # -> model; plug-in component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

mesh_data = Data(genpts.mesh)
mesh_data_2 = Data(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)

average_illuminance_data = Data(["63.06", "92.75", "241.68", "1785.63", "2610.77", "2587.14"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])
point_data = Data([Point(0.1421987035, -146.7080315, 6.76), Point(0.1421987035, -146.4079894, 6.76), Point(0.1421987035, -146.1079473, 6.76), Point(0.1421987035, -145.8079052, 6.76), Point(0.1421987035, -145.5078631, 6.76), Point(0.1421987035, -145.207821, 6.76)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])

# ----
# Visualize Average Illuminance
number_slider_2 = Slider(2000, range=0..10000)
legendpar = LBLegendParameters(min=0, max=number_slider_2)  # -> leg_par; plug-in component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
heatmap = LBSpatialHeatmap(values=simplify(average_illuminance_data), mesh=simplify(mesh_data_2), legend_par=legendpar)  # -> mesh, legend, title, colors, legend_par, vis_set; plug-in component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
mesh = Mesh(heatmap.mesh)

panel_5 = Panel("Case,OverlapChecked,TableType,AVG_Lux,W01,W02,W03,W04,W05,W06")
series_2 = Series(Start="0", Step=1, Count="4")

offset_from_the_wall = Slider(2, range=1..2)
columns = Slider(4, range=1..10)
rows = Slider(1, range=1..3)
angle = Panel("90")
brute_force = BruteForce(Run=Button(), Input1=offset_from_the_wall, Input2=columns, Input3=rows, Input4=angle, Input5=Slider(0, range=0..2))  # -> Permutation, Output1, Output2, Output3, Output4, Output5
rectangle = Rectangle(Plane=PlaneXY(0, 0, 0), XSize=Slider(10, range=0..100), YSize=Slider(25, range=0..100), Radius=0)  # -> Rectangle, Length
stream_filter = StreamFilter(Gate=brute_force.Output5, Stream0="01", Stream1="02", Stream2="03")
negative = Negative(Value=brute_force.Output1)
offset_curve = OffsetCurve(Curve=room_boundary, Distance=negative, Corners=1)
explode = Explode(Curve=offset_curve, Recursive=True)  # -> Segments, Vertices
list_item_4 = ListItem(List=explode.Segments, Index=0, Wrap=True)  # -> Item, Item1, Item2, Item3
geometry_2 = Geometry(list_item_4.Item)
geometry_3 = Geometry(list_item_4.Item2)
geometry_4 = Geometry(list_item_4.Item1)
geometry_5 = Geometry(list_item_4.Item3)
divide_curve = DivideCurve(Curve=geometry_2, Count=10, Kinks=False)  # -> Points, Tangents, Parameters
divide_curve_2 = DivideCurve(Curve=geometry_3, Count=10, Kinks=False)  # -> Points, Tangents, Parameters
number_slider_3 = Slider(0.5, range=0..1)  # disabled
reverse_list = ReverseList(List=divide_curve_2.Points)
point_list = PointList(Points=[divide_curve_2.Points, divide_curve.Points], Size=number_slider_3)  # disabled
entwine = Entwine(Branch00=divide_curve.Points, Branch01=reverse_list, FlattenInputs=True)
flip_matrix = FlipMatrix(Data=entwine)
reference_block_by_name = ReferenceBlockByName(BlockName=stream_filter, getNestedBlocks=False, lightweight=False)
polyline = PolyLine(Vertices=flip_matrix, Closed=False)  # -> flatten(Polyline)
explode_block = ExplodeBlock(Block=reference_block_by_name, recursive=False)  # -> Name, Transform, Geometry
surface = Surface(explode_block.Geometry)
area = Area(Geometry=surface)  # -> Area, Centroid

columns_2 = Data(brute_force.Output2)
rows_2 = Data(brute_force.Output3)

case_name = Data(brute_force.Permutation)
table_type = Data(explode_block.Name)
wall_offset = Data(brute_force.Output1)
rotation_angle = Data(brute_force.Output4)

# ---- group: CaseName
data = Data(case_name)
concatenate = Concatenate(FragmentA="CASE_", FragmentB=data)

# ----
table_type_2 = Data(table_type)
walloffset = Data(wall_offset)
rotationangle = Data(rotation_angle)

divide_curve_3 = DivideCurve(Curve=geometry_4, Count=rows_2, Kinks=False)  # -> Points, Tangents, Parameters
divide_curve_4 = DivideCurve(Curve=geometry_5, Count=rows_2, Kinks=False)  # -> Points, Tangents, Parameters
reverse_list_2 = ReverseList(List=divide_curve_4.Points)
entwine_2 = Entwine(Branch00=divide_curve_3.Points, Branch01=reverse_list_2, FlattenInputs=True)
flip_matrix_2 = FlipMatrix(Data=entwine_2)
polyline_2 = PolyLine(Vertices=flip_matrix_2, Closed=False)  # -> flatten(Polyline)
divide_curve_5 = DivideCurve(Curve=polyline_2, Count=columns_2, Kinks=False)  # -> Points, Tangents, Parameters
xy_plane = XYPlane(Origin=divide_curve_5.Points)

vector_2pt = Vector2Pt(PointA=area.Centroid, PointB=divide_curve_5.Points, Unitize=False)  # -> Vector, Length
move = Move(Geometry=explode_block.Geometry, Motion=vector_2pt.Vector)  # -> Geometry, Transform

rotate = Rotate(Geometry=move.Geometry, Angle=degrees(brute_force.Output4), Plane=xy_plane)  # -> Geometry, Transform
geometry_6 = Geometry(rotate.Geometry)

# ----
# Table data set
tablegeometry = Brep(geometry_6)

area_2 = Area(Geometry=graft(geometry_6))  # -> Area, simplify(Centroid)
deconstruct = Deconstruct(Point=area_2.Centroid)  # -> XComponent, YComponent, ZComponent
merge = Merge(Data1=deconstruct.XComponent, Data2=deconstruct.YComponent)
text_join_2 = TextJoin(Text=merge, Join=",")
collision_many_many = CollisionManyMany(Colliders=tablegeometry)  # -> simplify(flatten(Collision)), Indices
data_2 = Data(simplify(graft(collision_many_many.Collision)))
panel_6 = Panel(data_2)

# ----
# Run Recipe
boolean_toggle_2 = BooleanToggle(False)
morning_hour = Panel("7")
evening_hour = Panel("17")
analysisperiod = LBAnalysisPeriod(start_month=1, start_day=1, start_hour=morning_hour, end_hour=evening_hour)  # -> period, hoys, dates; plug-in component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

# ---- group: There is a change in the input or output! Replace this component manually.
annualdaylight = HBAnnualDaylight(model=assigngridsviews, wea=wea, enhanced=boolean_toggle_2, run=boolean_toggle)  # -> report, results, DA, cDA, UDI, UDI_low, UDI_up; plug-in component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

# ----
avgvalues = HBAnnualAverageValues(results=annualdaylight.results, hoys=analysisperiod.hoys, median=Toggle(True))  # -> out, values; plug-in component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

# ----
# 2 Collect Simulation Data
# (Link & Internalise data)
average_illuminance_data_2 = Data(avgvalues.values)
point_data_2 = Data(genpts.points)

unit_z = UnitZ(Factor="2")
extrude = Extrude(Base=tablegeometry, Direction=unit_z)  # -> simplify(Extrusion)
point_in_breps = PointInBreps(Brep=graft(extrude), Point=simplify(point_data), Strict=False)  # -> simplify(Inside), simplify(Index)
dispatch = Dispatch(List=average_illuminance_data, DispatchPattern=point_in_breps.Inside)  # -> ListA, ListB
match_tree = MatchTree(Tree=dispatch.ListA, Guide=point_in_breps.Inside)
data_3 = Data(simplify(flatten(text_join_2)))

number = Number(match_tree)
expression = Expression(x=number, Expression="Round(x,0)")

average = Average(Input=expression)  # -> flatten(ArithmeticMean)

shift_list = ShiftList(List=average, Shift=-1, Wrap=True)  # -> graft(List)
number_2 = Number(shift_list)
expression_2 = Expression(x=number_2, Expression="Round(x,0)")

unit_z_2 = UnitZ(Factor="1")
move_2 = Move(Geometry=tablegeometry, Motion=unit_z_2)  # -> Geometry, Transform
area_3 = Area(Geometry=move_2.Geometry)  # -> Area, Centroid
round = Round(Number=shift_list)  # -> Nearest, Floor, Ceiling
text_tag = TextTag(Location=simplify(area_3.Centroid), Text=simplify(round.Nearest), Colour=ColourSwatch(SwatchColor=RGB(153, 153, 153)))
custom_preview = CustomPreview(Geometry=move_2.Geometry, Material=ColourSwatch(SwatchColor=RGB(255, 255, 255)))

table_location = Panel(data_3)
illuminance_on_table = Panel(expression_2)
list_length_3 = ListLength(List=table_location)
panel_7 = Panel(concatenate)
duplicate_data_2 = DuplicateData(Data=panel_7, Number=list_length_3, Order=True)  # -> simplify(graft(Data))

duplicate_data_3 = DuplicateData(Data=table_type_2, Number=list_length_3, Order=True)  # -> simplify(graft(Data))
duplicate_data_4 = DuplicateData(Data=walloffset, Number=list_length_3, Order=True)
duplicate_data_5 = DuplicateData(Data=rotationangle, Number=list_length_3, Order=True)  # disabled
point = Point(table_location)
data_4 = Data(table_location)  # disabled
data_5 = Data(simplify(illuminance_on_table))
# 4 Save data
# 
# Right click on green panel and and click at
#      Strem destination  = choose folder to save
#      Steam content  = save data
panel_8 = Panel(duplicate_data_2)
panel_9 = Panel(duplicate_data_3)
panel_10 = Panel(data_5)

surface_2 = Surface(reference_by_layer)
area_4 = Area(Geometry=surface_2)  # -> Area, graft(Centroid)

project = Project(Geometry=area_4.Centroid, Plane=PlaneXY(0, 0, 0))  # -> Geometry, Transform

distance = Distance(PointA=point, PointB=project.Geometry)  # -> simplify(Distance)

panel_11 = Panel(distance)
explode_tree = ExplodeTree(Data=panel_11)  # -> simplify(graft(Branch0)), simplify(graft(Branch1)), simplify(graft(Branch2)), simplify(graft(Branch3)), simplify(graft(Branch4)), simplify(graft(Branch5))
panel_12 = Panel(explode_tree.Branch0)
panel_13 = Panel(explode_tree.Branch1)
panel_14 = Panel(explode_tree.Branch2)
panel_15 = Panel(explode_tree.Branch3)
panel_16 = Panel(explode_tree.Branch4)
panel_17 = Panel(explode_tree.Branch5)
entwine_3 = Entwine(
    Branch00=panel_8,
    Branch01=panel_6,
    Branch02=panel_9,
    Branch03=panel_10,
    Branch04=panel_12,
    Branch05=panel_13,
    Branch06=panel_14,
    Branch07=panel_15,
    Branch08=panel_16,
    Branch09=panel_17,
    FlattenInputs=True)
flip_matrix_3 = FlipMatrix(Data=entwine_3)
text_join_3 = TextJoin(Text=flip_matrix_3, Join=",")  # -> flatten(Result)
data_recorder = DataRecorder(text_join_3, DataLimit=-10, RecordData=True)
panel_18 = Panel(data_recorder)
cull_index = CullIndex(List=panel_18, Indices=series_2, Wrap=True)
create_csv = CreateCSV(DataGridHeaders=panel_5, ValueTree=cull_index, Delimiter=",")
panel_19 = Panel(create_csv)
